vi "Main.gviweb"   [LabVIEW NXG 2.1.0]
panel controls:
  "generate-fault": bool
  "clear-fault": bool
panel indicators:
  "debugging tips": string
  "URL Image": string
  "Data Grid": T1[]
  "errror out": error
types:
  T1 = cluster{"Battery": string, "Ramp": f64, "Trend": string, "Load": f64, "Status": string}
uses:
  NI::G Core::Error::Clear Error Cluster.gvi
  subvis::Initialize.gvi
  subvis::Read Example Tags.gvi
  subvis::FormatGrid.gvi
  subvis::Publish Message.gvi
  subvis::Determine Next State.gvi
diagram:
  w1 = "initialize"  # State
  # This diagram is idenitcal to Main.gvi
  s1 = uninitialised  # shift register
  s2 = uninitialised  # shift register
  s3 = w1  # shift register
  while {
    Wait(time to wait=250)
    case (s3) {
      frame "initialize", Default {
        $"URL Image" <- "happy-dino.jpg"
        # Read tags first to get their latest value
        w5 = ["customizingwebvis.battery.ramp.1", "customizingwebvis.battery.ramp.2", "customizingwebvis.battery.ramp.3", "customizingwebvis.battery.load.3", "customizingwebvis.battery.load.3", "customizingwebvis.battery.load.3"]
        # Clear errors and try to connect to the Skyline server.
        call "Clear Error Cluster.gvi"(error in=s1) -> (error out=w6)
        sequence {
          frame 0 {
            $"debugging tips" <- ""
          }
        }
        call "Initialize.gvi"(server url="https://api.systemlinkcloud.com", api key="oqQI651Yi2qoRft_ybcuYUX_rd5i1AP7vDmQTFKpPH", tag paths=w5, AuthPicker=1, error in=w6) -> (SystemLink Connection=w4, error out=w3)
        w2 = "read-tags"
      }
      frame "read-tags" {
        call "Read Example Tags.gvi"(SystemLink Connection=s2, error in=s1) -> (SystemLink Connection out=w4, ramp=w7, load=w8, error out=w9)
        call "FormatGrid.gvi"(ramp=w7, load=w8, Error In=w9) -> (Output=w10, Error Out=w3)
        $"Data Grid" <- w10
        Is Greater(x=w8, y=[12, 12, 12]) -> w11
        And Array Elements(Boolean array=w11) -> (logical AND=w12)
        Select(s=w12, t="angry-dino.png", f="happy-dino.jpg") -> w13
        $"URL Image" <- w13
        w2 = "read-tags"
      }
      frame "generate-fault" {
        w14 = "read-tags"  # State
        call "Publish Message.gvi"(SystemLink Connection=s2, message="generate-fault", error=s1) -> (SystemLink Connection out=w4, error out=w3)
        w2 = w14
      }
      frame "clear-fault" {
        w15 = "read-tags"  # State
        call "Publish Message.gvi"(SystemLink Connection=s2, message="clear-fault", error=s1) -> (SystemLink Connection out=w4, error out=w3)
        w2 = w15
      }
    }
    # init queue size
    call "Determine Next State.gvi"(state in=w2, generate-fault=$"generate-fault", clear-fault=$"clear-fault", error in=w3) -> (state out=w16, errror out=w17)
    $"errror out" <- w17
    next s1 = w17
    next s2 = w4
    next s3 = w16
    stop if FALSE
  }
