vi "Read Example Tags.gvi"   [LabVIEW NXG 2.1.0]
inputs:
  "error in": error
  "SystemLink Connection": T1
outputs:
  "error out": error
  "ramp": f64[]
  "tag clusters": "Tag Value Cluster.gtype"[]
  "load": f64[]
  "SystemLink Connection out": T1
types:
  "DataType.gtype" = enum{"Double", "Integer", "String"}
  "Tag.gtype" = cluster{"Path": string, "Datatype": "DataType.gtype", "Configuration": "Configuration.gtype"}
  "Message Session.gtype" = cluster{"Configuration": "Configuration.gtype", "token": string}
  T1 = cluster{"Tags": "Tag.gtype"[], "Message Topic": string, "Message Configuration": "Message Session.gtype"}
  "Tag Value Cluster.gtype" = cluster{"Path": string, "Data Type": "DataType.gtype", "Value": string, "Time Stamp": timestamp}
uses:
  NI::Skyline::TagHTTP::Multi Read.gvi
diagram:
  $"SystemLink Connection out" <- $"SystemLink Connection"
  Property Node(instance in=$"SystemLink Connection") -> ("Tags"=w1)
  case ($"error in") {
    frame Error, Default {
      w2 = $"error in"
      w3 = default
      w4 = f64[] []
    }
    frame No Error {
      call "Multi Read.gvi"(tags in=w1, error in=$"error in") -> (tags out=w5, tag clusters=w3, error out=w6)
      Array Size(array=w5) -> (size(s)=w7)
      for (N = w7) {
        w8 = each element of w3
        disable {
          frame Disabled {
            Random Number() -> (number (0 to 1)=w9)
          }
          frame Enabled {
            Property Node(instance in=w8) -> ("Value"=w10)
            Scan From String(inputString=w10, errIn=w6) -> (errOut=w2, out0=w9)
          }
        }
        append w9 to w4
      }
    }
  }
  $"tag clusters" <- w3
  $"error out" <- w2
  $load <- w4
  $ramp <- w4
